# Grasshopper definition Color Palette.gh (Grasshopper 1.0.7)
# Copyright: Reserved by Tian/TripleTrial
# plug-ins: Moonlight

number_slider = Slider(9.5, range=0..10)

base_zigzager = Slider(20, range=0..100)
height = Slider(55, range=0..100)
X = UnitX(Factor=1)
line = LineSDL(Start="{0,0,0}", Direction=X, Length=Slider(100, range=0..100))

# ----
# New defination starts here!
panel = Panel("#F2F2F2")

# ---- group: Color Module
swatch = ColourSwatch(SwatchColor=RGB(255, 255, 255))
ahsl = SplitAHSL(Colour=panel)  # -> Alpha, Hue, Saturation, Luminance

# ----
col = Colour(panel)

# ---- group: Display mode
moonlight = Moonlight(Mode=Toggle(False))

# ----
multiplication = Multiplication(A=ahsl.Luminance, B=base_zigzager)
move = Move(Motion=Vector(0, 0, 10))  # -> Geometry, Transform
multiplication_2 = Multiplication(B=Slider(9, range=0..10))
addition = Addition(A=multiplication_2, B=3)
divide = DivideCurve(Curve=line, Count=addition, Kinks=False)  # -> Points, Tangents, Parameters
panel_2 = Panel(multiplication_2)
pdecon = Deconstruct(Point=divide.Points)  # -> XComponent, YComponent, ZComponent
multiplication_3 = Multiplication(A=Slider(10, range=0..10), B=ahsl.Hue)
addition_2 = Addition(A=pdecon.XComponent, B=multiplication_3, C=3)
_100 = Multiplication(A=ahsl.Saturation, B=100)
graph = GraphMapper(
    addition_2,
    x0=0,
    x1=1,
    y0=0,
    y1=1,
    container_name="Sine Summation",
    Equation0_px=[0.1098110899, 0.4822467268],
    Equation0_py=[0.1117504835, 0.4048913121],
    Equation1_px=[0.6042949557, 0.824326694],
    Equation1_py=[0.3138993979, 0.5999499559])
addition_3 = Addition(A=_100, B=simplify(100))
multiplication_4 = Multiplication(A=graph, B=addition_3)
item = ListItem(List=multiplication_4, Index="0", Wrap=True)
subtraction = Subtraction(A=multiplication_4, B=item)
addition_4 = Addition(A=subtraction, B=height)
pt = ConstructPoint(XCoordinate=pdecon.XComponent, YCoordinate=pdecon.YComponent, ZCoordinate=addition_4)
number_slider_2 = Slider(3, range=0..10)
panel_3 = Panel(pt)
pt_2 = Point(pt)
intcrv = Interpolate(Vertices=pt_2, Degree=number_slider_2, Periodic=False, KnotStyle=1)  # -> Curve, Length, Domain
intcrv_2 = Interpolate(Vertices=divide.Points, Degree=number_slider_2, Periodic=False, KnotStyle=1)  # -> Curve, Length, Domain
loft = Loft(
    Curves=[intcrv.Curve, intcrv_2.Curve],
    Options={Adjust=True, Closed=False, LoftEnds=0, LoftSimp=1, LoftType=1, Rebuild=10, Refit=0.01})
sdivide = DivideSurface(Surface=loft, UCount=multiplication, VCount=Slider(15, range=0..100))  # -> Points, Normals, Parameters
intcrv_3 = Interpolate(Vertices=sdivide.Points, Degree=3, Periodic=False, KnotStyle=1)  # -> simplify(Curve), Length, Domain

# ---- group: Increased Dist
dom = ConstructDomain(DomainStart="1", DomainEnd=number_slider)
lng = ListLength(List=flatten(intcrv_3.Curve))
subtraction_2 = Subtraction(A=lng, B=1)
range = Range(Domain=dom, Steps=subtraction_2)

# ----
lng_2 = ListLength(List=flatten(intcrv_3.Curve))
series = Series(Start=0, Step=Slider(0.47, range=0..10), Count=lng_2)
eval = Evaluate(F="x ^ (3 - y)", x=series, y=ahsl.Luminance)
panel_4 = Panel(series)
Z = UnitZ(Factor=eval)
move_2 = Move(Geometry=flatten(intcrv_3.Curve), Motion=reverse(Z))  # -> Geometry, Transform
offset_l = OffsetCurveLoose(Curve=flatten(move_2.Geometry), Distance=number_slider, Plane=PlaneXY(0, 0, 0))
panel_5 = Panel("""0
1""")
lng_3 = ListLength(List=offset_l)
subtraction_3 = Subtraction(A=lng_3, B=1)
cull_i = CullIndex(List=offset_l, Indices=subtraction_3, Wrap=True)
weave = Weave(Pattern=panel_5, Stream0=flatten(move_2.Geometry), Stream1=flatten(cull_i), NullGaps=False)  # -> flatten(Weave)
loft_2 = Loft(Curves=reverse(weave), Options={Adjust=True, Closed=False, LoftEnds=0, LoftSimp=1, LoftType=3, Rebuild=50, Refit=0.01})
preview = CustomPreview(Geometry=loft_2, Material=col)

# ---- group: Domain divider
dom_2 = ConstructDomain(DomainStart=Slider(15, range=0..100), DomainEnd=Slider(15, range=0..100))
range_2 = Range(Domain=dom_2, Steps=Slider(34, range=0..100))

# ---- group: Change display color
# Welcome to my custom Library
number_slider_3 = Slider(1, range=0..1)
hsl = ColourHSL(Alpha=number_slider_3, Hue=Slider(1, range=0..1), Saturation=Slider(1, range=0..1), Luminance=Slider(0.55, range=0..1))
color_picker = CreateMaterial(Diffuse=hsl, Specular=RGB(255, 255, 255), Emission=RGB(0, 0, 0), Transparency=0, Shine=0)
preview_2 = CustomPreview(Material=color_picker)
