# Grasshopper definition Zhui.gh (Grasshopper 1.0.7)
# Copyright: Reserved by Tian/TripleTrial
# plug-ins: Moonlight

brep = Brep(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)
distance_of_offset = Slider(5.4, range=0..10)

height = Slider(72, range=0..100)
base_zigzager = Slider(15, range=0..100)
number_slider = Slider(70, range=0..100)
X = UnitX(Factor=1)
line = LineSDL(Start="{0,0,0}", Direction=X, Length=Slider(100, range=0..100))

# ----
# New defination starts here!
panel = Panel("#FBE7C3")
bbox = BoundingBox(Content=brep, Plane=PlaneXY(0, 0, 0))  # -> Box, Box_2
number_slider_2 = Slider(0, range=0..100)
col = Colour(panel)

# ---- group: Color Module
swatch = ColourSwatch(SwatchColor=RGB(38, 138, 33))
ahsl = SplitAHSL(Colour=col)  # -> Alpha, Hue, Saturation, Luminance

# ----
debox = DeconstructBox(Box=bbox.Box)  # -> Plane, X, Y, Z
graph = GraphMapper(
    ahsl.Luminance,
    x0=0,
    x1=1,
    y0=0,
    y1=1,
    container_name="Bezier",
    cpx=[0, 0.3722224534, 0.9892542958, 1],
    cpy=[0.1132847667, 0.1173909307, 0.4729344249, 0.766594708])
remap = RemapNumbers(Value=graph, Source=Domain(0, 1), Target="0.30 to 0.70")  # -> Mapped, Clipped

# ---- group: Display mode
moonlight = Moonlight(Mode=Toggle(False))

# ----
multiplication = Multiplication(A=graph, B=base_zigzager)
remap_2 = RemapNumbers(Value=[remap.Mapped, "0.02"], Source=Domain(0, 1), Target=debox.Z)  # -> Mapped, Clipped
pt = ConstructPoint(XCoordinate=number_slider_2, YCoordinate=number_slider_2, ZCoordinate=remap_2.Mapped)
pl = ConstructPlane(Origin=pt, XAxis=Vector(1, 0, 0), YAxis=Vector(0, 1, 0))
contour = ContourEx(Shape=brep, Plane=pl, Distances=0)  # -> flatten(Contours)

dispatch = Dispatch(List=contour, DispatchPattern=[True, False])  # -> ListA, ListB
dispatch_2 = Dispatch(List=remap_2.Mapped, DispatchPattern=[True, False])  # -> ListA, ListB

divide = DivideCurve(Curve=dispatch.ListA, Count=Slider(15, range=0..100), Kinks=False)  # -> Points, Tangents, Parameters
reb = RebuildCurve(Curve=dispatch.ListB, Count=number_slider, Tangents=False)
multiplication_2 = Multiplication(A=Slider(10, range=0..10), B=ahsl.Hue)
pdecon = Deconstruct(Point=divide.Points)  # -> XComponent, YComponent, ZComponent
addition = Addition(A=pdecon.XComponent, B=multiplication_2)
addition_2 = Addition(A=ahsl.Saturation, B=0.2)
_100 = Multiplication(A=addition_2, B=100)
graph_2 = GraphMapper(
    addition,
    x0=0,
    x1=1,
    y0=0,
    y1=1,
    container_name="Sine Summation",
    Equation0_px=[0.1098110899, 0.326492101],
    Equation0_py=[0.1117504835, 0.4992052317],
    Equation1_px=[0.6008601785, 0.9203977585],
    Equation1_py=[0.3427294493, 0.5153146982])
multiplication_3 = Multiplication(A=graph_2, B=_100)
item = ListItem(List=multiplication_3, Index="0", Wrap=True)
subtraction = Subtraction(A=multiplication_3, B=item)
addition_3 = Addition(A=subtraction, B=dispatch_2.ListA)
pt_2 = ConstructPoint(XCoordinate=pdecon.XComponent, YCoordinate=pdecon.YComponent, ZCoordinate=addition_3)
panel_2 = Panel(pt_2)
pt_3 = Point(pt_2)
intcrv = Interpolate(Vertices=pt_3, Degree=Slider(3, range=0..10), Periodic="true", KnotStyle=1)  # -> Curve, Length, Domain
reb_2 = RebuildCurve(Curve=intcrv.Curve, Count=number_slider, Tangents=False)
loft = Loft(
    Curves=flatten([reb_2, reb]),
    Options={Adjust=False, Closed=False, LoftEnds=0, LoftSimp=0, LoftType=0, Rebuild=10, Refit=0.01})
sdivide = DivideSurface(Surface=loft, UCount=multiplication, VCount=number_slider)  # -> Points, Normals, Parameters
intcrv_2 = Interpolate(Vertices=sdivide.Points, Degree=3, Periodic="true", KnotStyle=1)  # -> simplify(flatten(Curve)), Length, Domain
pull = PullCurve(Curve=intcrv_2.Curve, Surface=brep)

# ---- group: Increased Dist
dom = ConstructDomain(DomainStart="3", DomainEnd=distance_of_offset)
lng = ListLength(List=flatten(pull))
subtraction_2 = Subtraction(A=lng, B=1)
range = Range(Domain=dom, Steps=subtraction_2)

# ----
offset_l = OffsetCurveLoose(Curve=pull, Distance=range)
reb_3 = RebuildCurve(Curve=offset_l, Count="80", Tangents=False)
lng_2 = ListLength(List=offset_l)
panel_3 = Panel("""0
1""")
subtraction_3 = Subtraction(A=lng_2, B=1)
cull_i = CullIndex(List=flatten(reb_3), Indices=subtraction_3, Wrap=True)  # -> flatten(List)
weave = Weave(Pattern=panel_3, Stream0=flatten(pull), Stream1=flatten(cull_i), NullGaps=False)  # -> flatten(Weave)
loft_2 = Loft(Curves=reverse(weave), Options={Adjust=True, Closed=False, LoftEnds=0, LoftSimp=1, LoftType=3, Rebuild=70, Refit=0.01})
preview = CustomPreview(Geometry=[loft_2, brep], Material=col)

# ---- group: Domain divider
dom_2 = ConstructDomain(DomainStart=Slider(15, range=0..100), DomainEnd=Slider(15, range=0..100))
range_2 = Range(Domain=dom_2, Steps=Slider(34, range=0..100))

# ---- group: Change display color
# Welcome to my custom Library
number_slider_3 = Slider(1, range=0..1)
hsl = ColourHSL(Alpha=number_slider_3, Hue=Slider(1, range=0..1), Saturation=Slider(1, range=0..1), Luminance=Slider(0.55, range=0..1))
color_picker = CreateMaterial(Diffuse=hsl, Specular=RGB(255, 255, 255), Emission=RGB(0, 0, 0), Transparency=0, Shine=0)
preview_2 = CustomPreview(Material=color_picker)
